# Grasshopper definition lines_to_model.gh (Grasshopper 1.0.8)

path = FilePath("D:\W2 Workspace\output\paths.csv")
get_file_path = GetFilePath(path, AtLeast=1, AtMost=1, TreeAccess=False)
panel = Panel("Corner Detected + RDP")
file = ReadFile(File=get_file_path, PerLineParse=True)
lng = ListLength(List=file)
subtraction = Subtraction(A=lng, B=1)  # -> flatten(Result)
split = SplitList(List=file, Index=subtraction)  # -> ListA, flatten(ListB)
split_2 = TextSplit(Text=split.ListB, Separators=",")
lng_2 = ListLength(List=split_2)
py3 = Python3Script(paths=file, split_indices=lng_2)  # -> polyline_list, points_list; inputs paths: list
# ---------- py3: Python ----------
"""Grasshopper Script"""
import ghpythonlib.components as ghcomp
import Rhino.Geometry as rg


path_list = paths
path_list.pop()
length = split_indices - 1
polyline_list = []

points_list = [[] for _ in range(length)]
for p in path_list:
    formatted_sub = ghcomp.TextSplit(p, ",")
    path_id = formatted_sub[0]
    x = formatted_sub[1]
    y = formatted_sub[2]
    
    point = ghcomp.ConstructPoint(float(x), float(y), 0)
    points_list[int(path_id)].append(point)

for i in range(length):
    polyline_list.append(ghcomp.PolyLine(points_list[i], True))
# ---------- end py3 ----------
crv = Curve(py3.polyline_list)
line = Line(py3.polyline_list)  # disabled
Z = UnitZ(Factor=Slider(60, range=0..100))
boundary = BoundarySurfaces(Edges=py3.polyline_list)
simplify = SimplifyCurve(Curve=crv)  # -> Curve, Simplified
extr = Extrude(Base=[simplify.Curve, boundary], Direction=Z)
join = BrepJoin(Breps=extr)  # -> Breps, Closed
brep = Brep(join.Breps)
mesh = MeshBrep(
    Brep=join.Breps,
    Settings={GridMaxCount=0, GridMinCount=16, JaggedSeams=False, MaxEdgeLength=0, MinEdgeLength=0.0001, MinTolerance=0, Refine=True, RefineAngle=0, RelativeTolerance=0.65, SimplePlanes=True, Tolerance=0})

# ---- group: RH_OUT:Mesh
mesh_2 = Mesh(mesh)
